# Dynamo graph Auto Rename Types V 1.2.dyn (Dynamo 2.16.2.5624)
# packages: Clockwork for Dynamo 2.x 2.6.0, spring nodes 210.1.1, Rhythm 2023.9.1

# group: Walls
categories = Categories("OST_Walls")
all_family_types_of_category = Custom[All Family Types Of Category](category=categories)  # package Clockwork for Dynamo 2.x; Gets all family types/symbols of a given category in the model.
name = Custom[Element.Name+](element=all_family_types_of_category)  # package Clockwork for Dynamo 2.x; Gets an element's name. Unlike the OOTB node, this node should work for *all* Revit elements that have names and will also return the localized names of system parameters, parameter groups, display unit types, parameter types, unit symbol types, unit types and ForgeTypeIds.
string = StringInput("Stone")
contains = String.Contains(string=name, searchFor=string)
eq = name == contains
filterByBoolMask = List.FilterByBoolMask(list=all_family_types_of_category, mask=eq)
name_2 = Custom[Element.Name+](element=filterByBoolMask.in)
string_2 = StringInput("Stone-Brick_1")
contains_2 = String.Contains(string=name_2, searchFor=string_2)
eq_2 = name_2 == contains_2
filterByBoolMask_2 = List.FilterByBoolMask(list=filterByBoolMask.in, mask=eq_2)

# group: Stone Switch
name_3 = Custom[Element.Name+](element=filterByBoolMask_2.out)
string_3 = StringInput("Stone-Brick_2")
contains_3 = String.Contains(string=name_3, searchFor=string_3)
eq_3 = name_3 == contains_3
filterByBoolMask_3 = List.FilterByBoolMask(list=filterByBoolMask_2.out, mask=eq_3)

# group: Stone Switch
name_4 = Custom[Element.Name+](element=filterByBoolMask_3.out)
string_4 = StringInput("Stone-Brick_3")
contains_4 = String.Contains(string=name_4, searchFor=string_4)
eq_4 = name_4 == contains_4
filterByBoolMask_4 = List.FilterByBoolMask(list=filterByBoolMask_3.out, mask=eq_4)

# group: Stone Switch
name_5 = Custom[Element.Name+](element=filterByBoolMask_4.out)
string_5 = StringInput("Stone-Brick_4")
contains_5 = String.Contains(string=name_5, searchFor=string_5)
eq_5 = name_5 == contains_5
filterByBoolMask_5 = List.FilterByBoolMask(list=filterByBoolMask_4.out, mask=eq_5)

# group: Interior Stone
name_6 = Element.Name(element=filterByBoolMask_5.out)
code_block = CodeBlock { "Stone-Brick_Interior_1"; }
string_6 = StringInput(" - ")
code_block_2 = CodeBlock { "Width"; }
ʳʰʸᵗʰᵐ_elements = Rhythm.Revit.Elements.Elements.GetParameterValueByNameTypeOrInstance(element=filterByBoolMask_5.out, parameterName=code_block_2)
ꟿ_feet_tofraction = Custom[ꟿ Feet.ToFraction](number=ʳʰʸᵗʰᵐ_elements)  # package spring nodes; Converts a decimal foot value to a fractional foot/inch string.
add = string_6 + ꟿ_feet_tofraction
add_2 = code_block + add
replace = String.Replace(string=name_6, searchFor=name_6, replaceWith=add_2)
setName = Custom[Element.SetName](element=filterByBoolMask_5.out, name=replace)  # package Clockwork for Dynamo 2.x; Gets the name of a given Revit element

# group: Stone 4
name_7 = Element.Name(element=filterByBoolMask_5.in)
code_block_3 = CodeBlock { "Stone-Brick_4"; }
string_7 = StringInput(" - ")
code_block_4 = CodeBlock { "Width"; }
ʳʰʸᵗʰᵐ_elements_2 = Rhythm.Revit.Elements.Elements.GetParameterValueByNameTypeOrInstance(element=filterByBoolMask_5.in, parameterName=code_block_4)
ꟿ_feet_tofraction_2 = Custom[ꟿ Feet.ToFraction](number=ʳʰʸᵗʰᵐ_elements_2)
add_3 = string_7 + ꟿ_feet_tofraction_2
add_4 = code_block_3 + add_3
replace_2 = String.Replace(string=name_7, searchFor=name_7, replaceWith=add_4)
setName_2 = Custom[Element.SetName](element=filterByBoolMask_5.in, name=replace_2)

# group: Stone 3
name_8 = Element.Name(element=filterByBoolMask_4.in)
code_block_5 = CodeBlock { "Stone-Brick_3"; }
string_8 = StringInput(" - ")
code_block_6 = CodeBlock { "Width"; }
ʳʰʸᵗʰᵐ_elements_3 = Rhythm.Revit.Elements.Elements.GetParameterValueByNameTypeOrInstance(element=filterByBoolMask_4.in, parameterName=code_block_6)
ꟿ_feet_tofraction_3 = Custom[ꟿ Feet.ToFraction](number=ʳʰʸᵗʰᵐ_elements_3)
add_5 = string_8 + ꟿ_feet_tofraction_3
add_6 = code_block_5 + add_5
replace_3 = String.Replace(string=name_8, searchFor=name_8, replaceWith=add_6)
setName_3 = Custom[Element.SetName](element=filterByBoolMask_4.in, name=replace_3)

# group: Stone 2
name_9 = Element.Name(element=filterByBoolMask_3.in)
code_block_7 = CodeBlock { "Stone-Brick_2"; }
string_9 = StringInput(" - ")
code_block_8 = CodeBlock { "Width"; }
ʳʰʸᵗʰᵐ_elements_4 = Rhythm.Revit.Elements.Elements.GetParameterValueByNameTypeOrInstance(element=filterByBoolMask_3.in, parameterName=code_block_8)
ꟿ_feet_tofraction_4 = Custom[ꟿ Feet.ToFraction](number=ʳʰʸᵗʰᵐ_elements_4)
add_7 = string_9 + ꟿ_feet_tofraction_4
add_8 = code_block_7 + add_7
replace_4 = String.Replace(string=name_9, searchFor=name_9, replaceWith=add_8)
setName_4 = Custom[Element.SetName](element=filterByBoolMask_3.in, name=replace_4)

# group: Stone 1
name_10 = Element.Name(element=filterByBoolMask_2.in)
code_block_9 = CodeBlock { "Stone-Brick_1"; }
string_10 = StringInput(" - ")
code_block_10 = CodeBlock { "Width"; }
ʳʰʸᵗʰᵐ_elements_5 = Rhythm.Revit.Elements.Elements.GetParameterValueByNameTypeOrInstance(element=filterByBoolMask_2.in, parameterName=code_block_10)
ꟿ_feet_tofraction_5 = Custom[ꟿ Feet.ToFraction](number=ʳʰʸᵗʰᵐ_elements_5)
add_9 = string_10 + ꟿ_feet_tofraction_5
add_10 = code_block_9 + add_9
replace_5 = String.Replace(string=name_10, searchFor=name_10, replaceWith=add_10)
setName_5 = Custom[Element.SetName](element=filterByBoolMask_2.in, name=replace_5)

# group: Type Rename
categories_2 = Categories("OST_Ceilings")
all_family_types_of_category_2 = Custom[All Family Types Of Category](category=categories_2)
name_11 = Custom[Element.Name+](element=all_family_types_of_category_2)
string_11 = StringInput("Ceilings")
contains_6 = String.Contains(string=name_11, searchFor=string_11)
eq_6 = name_11 == contains_6
filterByBoolMask_6 = List.FilterByBoolMask(list=all_family_types_of_category_2, mask=eq_6)
name_12 = Element.Name(element=filterByBoolMask_6.in)
string_12 = StringInput("WTS_Interior_Ceiling ")
replace_6 = String.Replace(string=name_12, searchFor=name_12, replaceWith=string_12)
setName_6 = Custom[Element.SetName](element=filterByBoolMask_6.in, name=replace_6)
name_13 = Element.Name(element=filterByBoolMask_6.out)
code_block_11 = CodeBlock { "Generic"; }
eq_7 = name_13 == code_block_11
filterByBoolMask_7 = List.FilterByBoolMask(list=filterByBoolMask_6.out, mask=eq_7)
name_14 = Element.Name(element=filterByBoolMask_7.out)
code_block_12 = CodeBlock { " "; }
code_block_13 = CodeBlock { "Thickness"; }
ʳʰʸᵗʰᵐ_elements_6 = Rhythm.Revit.Elements.Elements.GetParameterValueByNameTypeOrInstance(element=filterByBoolMask_7.out, parameterName=code_block_13)
ꟿ_feet_tofraction_6 = Custom[ꟿ Feet.ToFraction](number=ʳʰʸᵗʰᵐ_elements_6)
add_11 = code_block_12 + ꟿ_feet_tofraction_6
add_12 = name_14 + add_11
replace_7 = String.Replace(string=name_14, searchFor=name_14, replaceWith=add_12)
setName_7 = Custom[Element.SetName](element=filterByBoolMask_7.out, name=replace_7)

# group: Category Rename
categories_3 = Categories("OST_Roofs")
all_families_of_category = Custom[All Families Of Category](category=categories_3)  # package Clockwork for Dynamo 2.x; Gets all famiies of a given category in the model (does *not *work for system families)
name_15 = Custom[Element.Name+](element=all_families_of_category)
string_13 = StringInput("Roofs ")
contains_7 = String.Contains(string=name_15, searchFor=string_13)
eq_8 = name_15 == contains_7
filterByBoolMask_8 = List.FilterByBoolMask(list=all_families_of_category, mask=eq_8)
name_16 = Element.Name(element=filterByBoolMask_8.in)
string_14 = StringInput("Basic Roof ")
replace_8 = String.Replace(string=name_16, searchFor=name_16, replaceWith=string_14)
indexOf = List.IndexOf(list=filterByBoolMask_8.in, element=filterByBoolMask_8.in)
code_block_14 = CodeBlock { 1; }
add_13 = indexOf + code_block_14
string_from_object = FromObject(object=add_13)
add_14 = replace_8 + string_from_object
replace_9 = String.Replace(string=name_16, searchFor=name_16, replaceWith=add_14)
setName_8 = Custom[Element.SetName](element=filterByBoolMask_8.in, name=replace_9)

# group: Type Rename
categories_4 = Categories("OST_Ceilings")
all_family_types_of_category_3 = Custom[All Family Types Of Category](category=categories_4)
name_17 = Custom[Element.Name+](element=all_family_types_of_category_3)
string_15 = StringInput("Ceilings")
contains_8 = String.Contains(string=name_17, searchFor=string_15)
eq_9 = name_17 == contains_8
filterByBoolMask_9 = List.FilterByBoolMask(list=all_family_types_of_category_3, mask=eq_9)
name_18 = Element.Name(element=filterByBoolMask_9.in)
string_16 = StringInput("WTS_Interior_Ceiling ")
replace_10 = String.Replace(string=name_18, searchFor=name_18, replaceWith=string_16)
setName_9 = Custom[Element.SetName](element=filterByBoolMask_9.in, name=replace_10)

# group: Category Rename
categories_5 = Categories("OST_Ceilings")
all_families_of_category_2 = Custom[All Families Of Category](category=categories_5)
name_19 = Custom[Element.Name+](element=all_families_of_category_2)
string_17 = StringInput("Ceilings")
contains_9 = String.Contains(string=name_19, searchFor=string_17)
eq_10 = name_19 == contains_9
filterByBoolMask_10 = List.FilterByBoolMask(list=all_families_of_category_2, mask=eq_10)
name_20 = Element.Name(element=filterByBoolMask_10.in)
string_18 = StringInput("Compound Ceiling Cut")
replace_11 = String.Replace(string=name_20, searchFor=name_20, replaceWith=string_18)
code_block_15 = CodeBlock { " "; }
indexOf_2 = List.IndexOf(list=filterByBoolMask_10.in, element=filterByBoolMask_10.in)
string_from_object_2 = FromObject(object=indexOf_2)
string_19 = StringInput("0")
string_20 = StringInput("")
replace_12 = String.Replace(string=string_from_object_2, searchFor=string_19, replaceWith=string_20)
add_15 = code_block_15 + replace_12
add_16 = replace_11 + add_15
replace_13 = String.Replace(string=name_20, searchFor=name_20, replaceWith=add_16)
trimTrailingWhitespace = String.TrimTrailingWhitespace(string=replace_13)
setName_10 = Custom[Element.SetName](element=filterByBoolMask_10.in, name=trimTrailingWhitespace)
