# Dynamo graph Auto Rename V 1.6 .dyn "Auto Rename V 1.6" (Dynamo 2.16.2.5624)
# packages: Clockwork for Dynamo 2.x 2.6.0

# group: Windows Control
categories = Categories("OST_Windows")
all_family_types_of_category = Custom[All Family Types Of Category](category=categories)  # package Clockwork for Dynamo 2.x; Gets all family types/symbols of a given category in the model.
name = Element.Name(element=all_family_types_of_category)
number_slider = DoubleSlider(0, range=0..10 step 1)
number_slider_2 = DoubleSlider(4, range=0..10 step 1)
substring = String.Substring(string=name, startIndex=number_slider, length=number_slider_2)
code_block = CodeBlock { "Main"; }
eq = substring == code_block
filterByBoolMask = List.FilterByBoolMask(list=all_family_types_of_category, mask=eq)

# group: Sacondary Windows
code_block_2 = CodeBlock { "Width"; }
autoRename = Custom[AutoRename](element=filterByBoolMask.out, parameterName=code_block_2)
code_block_3 = CodeBlock { "Height"; }
autoRename_2 = Custom[AutoRename](element=filterByBoolMask.out, parameterName=code_block_3)
add = autoRename + autoRename_2
code_block_4 = CodeBlock { " "; }
string = StringInput("")
replace = String.Replace(string=add, searchFor=code_block_4, replaceWith=string)
code_block_5 = CodeBlock { 0; }
door_window_location = CustomSelection("Secondary", items={Main: "Main - ", Secondary: "Secondary - ", Interior: ""})
insert = String.Insert(string=replace, index=code_block_5, toInsert=door_window_location)

# group: Secondary Windows
name_2 = Element.Name(element=filterByBoolMask.out)
replace_2 = String.Replace(string=name_2, searchFor=name_2, replaceWith=insert)
setName = Custom[Element.SetName](element=filterByBoolMask.out, name=replace_2)  # frozen; package Clockwork for Dynamo 2.x; Gets the name of a given Revit element

# group: Main Windows
code_block_6 = CodeBlock { "Width"; }
autoRename_3 = Custom[AutoRename](element=filterByBoolMask.in, parameterName=code_block_6)
code_block_7 = CodeBlock { "Height"; }
autoRename_4 = Custom[AutoRename](element=filterByBoolMask.in, parameterName=code_block_7)
add_2 = autoRename_3 + autoRename_4
code_block_8 = CodeBlock { " "; }
string_2 = StringInput("")
replace_3 = String.Replace(string=add_2, searchFor=code_block_8, replaceWith=string_2)
code_block_9 = CodeBlock { 0; }
door_window_location_2 = CustomSelection("Main", items={Main: "Main - ", Secondary: "Secondary - ", Interior: ""})
insert_2 = String.Insert(string=replace_3, index=code_block_9, toInsert=door_window_location_2)

# group: Main Windows
name_3 = Element.Name(element=filterByBoolMask.in)
replace_4 = String.Replace(string=name_3, searchFor=name_3, replaceWith=insert_2)
setName_2 = Custom[Element.SetName](element=filterByBoolMask.in, name=replace_4)  # frozen
