# Dynamo graph Celling auto rename.dyn (Dynamo 2.16.2.5624)
# packages: Clockwork for Dynamo 2.x 2.6.0, Rhythm 2023.9.1, spring nodes 210.1.1

# group: Category Rename
categories = Categories("OST_Ceilings")
all_families_of_category = Custom[All Families Of Category](category=categories)  # package Clockwork for Dynamo 2.x; Gets all famiies of a given category in the model (does *not *work for system families)
name = Custom[Element.Name+](element=all_families_of_category)  # package Clockwork for Dynamo 2.x; Gets an element's name. Unlike the OOTB node, this node should work for *all* Revit elements that have names and will also return the localized names of system parameters, parameter groups, display unit types, parameter types, unit symbol types, unit types and ForgeTypeIds.
string = StringInput("Ceilings")
contains = String.Contains(string=name, searchFor=string)
eq = name == contains
filterByBoolMask = List.FilterByBoolMask(list=all_families_of_category, mask=eq)
name_2 = Element.Name(element=filterByBoolMask.in)
string_2 = StringInput("Compound Ceiling Cut")
replace = String.Replace(string=name_2, searchFor=name_2, replaceWith=string_2)
code_block = CodeBlock { " "; }
indexOf = List.IndexOf(list=filterByBoolMask.in, element=filterByBoolMask.in)
string_from_object = FromObject(object=indexOf)
string_3 = StringInput("0")
string_4 = StringInput("")
replace_2 = String.Replace(string=string_from_object, searchFor=string_3, replaceWith=string_4)
add = code_block + replace_2
add_2 = replace + add
replace_3 = String.Replace(string=name_2, searchFor=name_2, replaceWith=add_2)
trimTrailingWhitespace = String.TrimTrailingWhitespace(string=replace_3)
setName = Custom[Element.SetName](element=filterByBoolMask.in, name=trimTrailingWhitespace)  # package Clockwork for Dynamo 2.x; Gets the name of a given Revit element

# group: Type Rename
categories_2 = Categories("OST_Ceilings")
all_family_types_of_category = Custom[All Family Types Of Category](category=categories_2)  # package Clockwork for Dynamo 2.x; Gets all family types/symbols of a given category in the model.
name_3 = Custom[Element.Name+](element=all_family_types_of_category)
string_5 = StringInput("Ceilings")
contains_2 = String.Contains(string=name_3, searchFor=string_5)
eq_2 = name_3 == contains_2
filterByBoolMask_2 = List.FilterByBoolMask(list=all_family_types_of_category, mask=eq_2)
name_4 = Element.Name(element=filterByBoolMask_2.in)
string_6 = StringInput("WTS_Interior_Ceiling ")
replace_4 = String.Replace(string=name_4, searchFor=name_4, replaceWith=string_6)
setName_2 = Custom[Element.SetName](element=filterByBoolMask_2.in, name=replace_4)
name_5 = Element.Name(element=filterByBoolMask_2.out)
code_block_2 = CodeBlock { "Generic"; }
eq_3 = name_5 == code_block_2
filterByBoolMask_3 = List.FilterByBoolMask(list=filterByBoolMask_2.out, mask=eq_3)
name_6 = Element.Name(element=filterByBoolMask_3.out)
code_block_3 = CodeBlock { " "; }
code_block_4 = CodeBlock { "Thickness"; }
ʳʰʸᵗʰᵐ_elements = Rhythm.Revit.Elements.Elements.GetParameterValueByNameTypeOrInstance(element=filterByBoolMask_3.out, parameterName=code_block_4)
ꟿ_feet_tofraction = Custom[ꟿ Feet.ToFraction](number=ʳʰʸᵗʰᵐ_elements)  # package spring nodes; Converts a decimal foot value to a fractional foot/inch string.
add_3 = code_block_3 + ꟿ_feet_tofraction
add_4 = name_6 + add_3
replace_5 = String.Replace(string=name_6, searchFor=name_6, replaceWith=add_4)
setName_3 = Custom[Element.SetName](element=filterByBoolMask_3.out, name=replace_5)
