# Dynamo graph Roof auto rename.dyn (Dynamo 2.16.2.5624)
# packages: Clockwork for Dynamo 2.x 2.6.0

# group: Category Rename
categories = Categories("OST_Roofs")
all_families_of_category = Custom[All Families Of Category](category=categories)  # package Clockwork for Dynamo 2.x; Gets all famiies of a given category in the model (does *not *work for system families)
name = Custom[Element.Name+](element=all_families_of_category)  # package Clockwork for Dynamo 2.x; Gets an element's name. Unlike the OOTB node, this node should work for *all* Revit elements that have names and will also return the localized names of system parameters, parameter groups, display unit types, parameter types, unit symbol types, unit types and ForgeTypeIds.
string = StringInput("Roofs ")
contains = String.Contains(string=name, searchFor=string)
eq = name == contains
filterByBoolMask = List.FilterByBoolMask(list=all_families_of_category, mask=eq)
name_2 = Element.Name(element=filterByBoolMask.in)
string_2 = StringInput("Basic Roof ")
replace = String.Replace(string=name_2, searchFor=name_2, replaceWith=string_2)
indexOf = List.IndexOf(list=filterByBoolMask.in, element=filterByBoolMask.in)
code_block = CodeBlock { 1; }
add = indexOf + code_block
string_from_object = FromObject(object=add)
add_2 = replace + string_from_object
replace_2 = String.Replace(string=name_2, searchFor=name_2, replaceWith=add_2)
setName = Custom[Element.SetName](element=filterByBoolMask.in, name=replace_2)  # package Clockwork for Dynamo 2.x; Gets the name of a given Revit element

# group: Type Rename
categories_2 = Categories("OST_Roofs")
all_family_types_of_category = Custom[All Family Types Of Category](category=categories_2)  # package Clockwork for Dynamo 2.x; Gets all family types/symbols of a given category in the model.
name_3 = Custom[Element.Name+](element=all_family_types_of_category)
string_3 = StringInput("Roofs ")
contains_2 = String.Contains(string=name_3, searchFor=string_3)
eq_2 = name_3 == contains_2
filterByBoolMask_2 = List.FilterByBoolMask(list=all_family_types_of_category, mask=eq_2)
name_4 = Element.Name(element=filterByBoolMask_2.in)
string_4 = StringInput("WTS_Roof_Covering")
replace_3 = String.Replace(string=name_4, searchFor=name_4, replaceWith=string_4)
setName_2 = Custom[Element.SetName](element=filterByBoolMask_2.in, name=replace_3)
