# Dynamo graph Stone Wall auto rename.dyn (Dynamo 2.16.2.5624)
# packages: Clockwork for Dynamo 2.x 2.6.0, Rhythm 2023.9.1, spring nodes 210.1.1

# group: Walls
categories = Categories("OST_Walls")
all_family_types_of_category = Custom[All Family Types Of Category](category=categories)  # package Clockwork for Dynamo 2.x; Gets all family types/symbols of a given category in the model.
name = Custom[Element.Name+](element=all_family_types_of_category)  # package Clockwork for Dynamo 2.x; Gets an element's name. Unlike the OOTB node, this node should work for *all* Revit elements that have names and will also return the localized names of system parameters, parameter groups, display unit types, parameter types, unit symbol types, unit types and ForgeTypeIds.
string = StringInput("Stone")
contains = String.Contains(string=name, searchFor=string)
eq = name == contains
filterByBoolMask = List.FilterByBoolMask(list=all_family_types_of_category, mask=eq)
name_2 = Custom[Element.Name+](element=filterByBoolMask.in)
string_2 = StringInput("Stone-Brick_1")
contains_2 = String.Contains(string=name_2, searchFor=string_2)
eq_2 = name_2 == contains_2
filterByBoolMask_2 = List.FilterByBoolMask(list=filterByBoolMask.in, mask=eq_2)

# group: Stone 1
name_3 = Element.Name(element=filterByBoolMask_2.in)
code_block = CodeBlock { "Stone-Brick_1"; }
string_3 = StringInput(" - ")
code_block_2 = CodeBlock { "Width"; }
ʳʰʸᵗʰᵐ_elements = Rhythm.Revit.Elements.Elements.GetParameterValueByNameTypeOrInstance(element=filterByBoolMask_2.in, parameterName=code_block_2)
ꟿ_feet_tofraction = Custom[ꟿ Feet.ToFraction](number=ʳʰʸᵗʰᵐ_elements)  # package spring nodes; Converts a decimal foot value to a fractional foot/inch string.
add = string_3 + ꟿ_feet_tofraction
add_2 = code_block + add
replace = String.Replace(string=name_3, searchFor=name_3, replaceWith=add_2)
setName = Custom[Element.SetName](element=filterByBoolMask_2.in, name=replace)  # package Clockwork for Dynamo 2.x; Gets the name of a given Revit element

# group: Stone Switch
name_4 = Custom[Element.Name+](element=filterByBoolMask_2.out)
string_4 = StringInput("Stone-Brick_2")
contains_3 = String.Contains(string=name_4, searchFor=string_4)
eq_3 = name_4 == contains_3
filterByBoolMask_3 = List.FilterByBoolMask(list=filterByBoolMask_2.out, mask=eq_3)

# group: Stone 2
name_5 = Element.Name(element=filterByBoolMask_3.in)
code_block_3 = CodeBlock { "Stone-Brick_2"; }
string_5 = StringInput(" - ")
code_block_4 = CodeBlock { "Width"; }
ʳʰʸᵗʰᵐ_elements_2 = Rhythm.Revit.Elements.Elements.GetParameterValueByNameTypeOrInstance(element=filterByBoolMask_3.in, parameterName=code_block_4)
ꟿ_feet_tofraction_2 = Custom[ꟿ Feet.ToFraction](number=ʳʰʸᵗʰᵐ_elements_2)
add_3 = string_5 + ꟿ_feet_tofraction_2
add_4 = code_block_3 + add_3
replace_2 = String.Replace(string=name_5, searchFor=name_5, replaceWith=add_4)
setName_2 = Custom[Element.SetName](element=filterByBoolMask_3.in, name=replace_2)

# group: Stone Switch
name_6 = Custom[Element.Name+](element=filterByBoolMask_3.out)
string_6 = StringInput("Stone-Brick_3")
contains_4 = String.Contains(string=name_6, searchFor=string_6)
eq_4 = name_6 == contains_4
filterByBoolMask_4 = List.FilterByBoolMask(list=filterByBoolMask_3.out, mask=eq_4)

# group: Stone 3
name_7 = Element.Name(element=filterByBoolMask_4.in)
code_block_5 = CodeBlock { "Stone-Brick_3"; }
string_7 = StringInput(" - ")
code_block_6 = CodeBlock { "Width"; }
ʳʰʸᵗʰᵐ_elements_3 = Rhythm.Revit.Elements.Elements.GetParameterValueByNameTypeOrInstance(element=filterByBoolMask_4.in, parameterName=code_block_6)
ꟿ_feet_tofraction_3 = Custom[ꟿ Feet.ToFraction](number=ʳʰʸᵗʰᵐ_elements_3)
add_5 = string_7 + ꟿ_feet_tofraction_3
add_6 = code_block_5 + add_5
replace_3 = String.Replace(string=name_7, searchFor=name_7, replaceWith=add_6)
setName_3 = Custom[Element.SetName](element=filterByBoolMask_4.in, name=replace_3)

# group: Stone Switch
name_8 = Custom[Element.Name+](element=filterByBoolMask_4.out)
string_8 = StringInput("Stone-Brick_4")
contains_5 = String.Contains(string=name_8, searchFor=string_8)
eq_5 = name_8 == contains_5
filterByBoolMask_5 = List.FilterByBoolMask(list=filterByBoolMask_4.out, mask=eq_5)

# group: Stone 4
name_9 = Element.Name(element=filterByBoolMask_5.in)
code_block_7 = CodeBlock { "Stone-Brick_4"; }
string_9 = StringInput(" - ")
code_block_8 = CodeBlock { "Width"; }
ʳʰʸᵗʰᵐ_elements_4 = Rhythm.Revit.Elements.Elements.GetParameterValueByNameTypeOrInstance(element=filterByBoolMask_5.in, parameterName=code_block_8)
ꟿ_feet_tofraction_4 = Custom[ꟿ Feet.ToFraction](number=ʳʰʸᵗʰᵐ_elements_4)
add_7 = string_9 + ꟿ_feet_tofraction_4
add_8 = code_block_7 + add_7
replace_4 = String.Replace(string=name_9, searchFor=name_9, replaceWith=add_8)
setName_4 = Custom[Element.SetName](element=filterByBoolMask_5.in, name=replace_4)

# group: Interior Stone
name_10 = Element.Name(element=filterByBoolMask_5.out)
code_block_9 = CodeBlock { "Stone-Brick_Interior_1"; }
string_10 = StringInput(" - ")
code_block_10 = CodeBlock { "Width"; }
ʳʰʸᵗʰᵐ_elements_5 = Rhythm.Revit.Elements.Elements.GetParameterValueByNameTypeOrInstance(element=filterByBoolMask_5.out, parameterName=code_block_10)
ꟿ_feet_tofraction_5 = Custom[ꟿ Feet.ToFraction](number=ʳʰʸᵗʰᵐ_elements_5)
add_9 = string_10 + ꟿ_feet_tofraction_5
add_10 = code_block_9 + add_9
replace_5 = String.Replace(string=name_10, searchFor=name_10, replaceWith=add_10)
setName_5 = Custom[Element.SetName](element=filterByBoolMask_5.out, name=replace_5)
